% Simulink data dictionary MotorControl.sldd

HallExtiFlag = Simulink.Signal(StorageClass="ExportedGlobal", DataType="uint8", InitialValue="0")
HallState = Simulink.Signal(StorageClass="ExportedGlobal", DataType="uint8", InitialValue="0")
Key1State = Simulink.Signal(StorageClass="ExportedGlobal", DataType="uint8", InitialValue="0")
Key2State = Simulink.Signal(StorageClass="ExportedGlobal", DataType="uint8", InitialValue="0")
StartMotorReq = Simulink.Signal(StorageClass="ExportedGlobal", DataType="uint8", InitialValue="0")
StopMotorReq = Simulink.Signal(StorageClass="ExportedGlobal", DataType="uint8", InitialValue="0")
MotorState = Simulink.Signal(StorageClass="ExportedGlobal", DataType="Enum: Enum_MotorState", InitialValue="Enum_MotorState.Init")
Get_HallAState = Simulink.Signal(StorageClass="GetSet", HeaderFile="main.h", GetFunction="$N", DataType="uint8", InitialValue="0")
Get_HallBState = Simulink.Signal(StorageClass="GetSet", HeaderFile="main.h", GetFunction="$N", DataType="uint8", InitialValue="0")
Get_HallCState = Simulink.Signal(StorageClass="GetSet", HeaderFile="main.h", GetFunction="$N", DataType="uint8", InitialValue="0")
Get_Key1State = Simulink.Signal(StorageClass="GetSet", HeaderFile="main.h", GetFunction="$N", DataType="uint8", InitialValue="0")
Get_Key2State = Simulink.Signal(StorageClass="GetSet", HeaderFile="main.h", GetFunction="$N", DataType="uint8", InitialValue="0")
Set_T1PWM = Simulink.Signal(StorageClass="GetSet", HeaderFile="main.h", SetFunction="$N", DataType="uint32", InitialValue="0")
Set_T2Status = Simulink.Signal(StorageClass="GetSet", HeaderFile="main.h", SetFunction="$N", DataType="uint8", InitialValue="0")
Set_T3PWM = Simulink.Signal(StorageClass="GetSet", HeaderFile="main.h", SetFunction="$N", DataType="uint32", InitialValue="0")
Set_T4Status = Simulink.Signal(StorageClass="GetSet", HeaderFile="main.h", SetFunction="$N", DataType="uint8", InitialValue="0")
Set_T5PWM = Simulink.Signal(StorageClass="GetSet", HeaderFile="main.h", SetFunction="$N", DataType="uint32", InitialValue="0")
Set_T6Status = Simulink.Signal(StorageClass="GetSet", HeaderFile="main.h", SetFunction="$N", DataType="uint8", InitialValue="0")

Enum_MotorState = enum(DefaultValue="Stop", StorageType="uint8", AddClassNameToEnumNames=true)
  Init = 0
  Stop = 1
  Start = 2
  Run = 3

Set_StartStopMotor = Simulink.Signal(StorageClass="GetSet", HeaderFile="main.h", SetFunction="$N", DataType="uint8", InitialValue="0")
TestState = Simulink.Signal(StorageClass="ExportedGlobal", DataType="uint8", InitialValue="0")
PWMValue = Simulink.Parameter(1000, StorageClass="ExportedGlobal", DataType="uint32")